# Grasshopper definition Lesson_2_-_DNA_strain_sol.gh (Grasshopper 1.0.8)
# plug-ins: Bifocals

# ----
# Creating a single strand
number_slider = Slider(7, range=0..10)
neg = Negative(Value=number_slider)
pt = ConstructPoint(XCoordinate=number_slider, YCoordinate=0, ZCoordinate=0)
pt_2 = ConstructPoint(XCoordinate=neg, YCoordinate=0, ZCoordinate=0)
merge = Merge(Data1=pt, Data2=pt_2)
ln = Line(StartPoint=pt, EndPoint=pt_2)
pipe_radius = Slider(0.5, range=0..2)
ball_radius = Slider(1.1, range=0..10)
pipe = Pipe(Curve=ln, Radius=pipe_radius, Caps=Slider(1, range=0..1))
sph = Sphere(Base=merge, Radius=ball_radius)
sunion = SolidUnion(Breps=flatten([sph, pipe]))

number_slider_2 = Slider(16, range=0..100)
# Create a list of strands
series = Series(Start=0, Step=Slider(5, range=0..10), Count=number_slider_2)
# Rotate the strands
unit_z = UnitZ(Factor=series)
move = Move(Geometry=sunion, Motion=unit_z)  # -> Geometry, Transform
series_2 = Series(Start=0, Step=Slider(0.35, range=0..1), Count=number_slider_2)
panel = Panel(series_2)
# Render the result
rotate = Rotate(Geometry=move.Geometry, Angle=series_2, Plane=PlaneXY(0, 0, 0))  # -> Geometry, Transform
