# Grasshopper definition Lesson_2_-_DNA_strain_starting_file.gh (Grasshopper 1.0.7)

# ----
# Creating a single strand
number_slider = Slider(7, range=0..10)
neg = Negative(Value=number_slider)
pt = ConstructPoint(XCoordinate=number_slider, YCoordinate=0, ZCoordinate=0)
pt_2 = ConstructPoint(XCoordinate=neg, YCoordinate=0, ZCoordinate=0)
merge = Merge(Data1=pt, Data2=pt_2)
ln = Line(StartPoint=pt, EndPoint=pt_2)
pipe_radius = Slider(0.5, range=0..2)
ball_radius = Slider(1.1, range=0..10)
pipe = Pipe(Curve=ln, Radius=pipe_radius, Caps=Slider(1, range=0..1))
sph = Sphere(Base=merge, Radius=ball_radius)
# Create a list of strands
# Render the result
# Rotate the strands
sunion = SolidUnion(Breps=flatten([sph, pipe]))

number_of_strands = Slider(0, range=0..100)
# Hint: use these components
series = Series(Start=0, Step=1, Count=number_of_strands)
series_2 = Series(Start=0, Step=1, Count=number_of_strands)
move = Move(Motion=Vector(0, 0, 10))  # -> Geometry, Transform
rotate = Rotate(Angle=1.570796327, Plane=PlaneXY(0, 0, 0))  # -> Geometry, Transform
