# Grasshopper definition week2_2.gh (Grasshopper 1.0.8)
# plug-ins: Bifocals

number_slider = Slider(780, range=1..2000)
number_slider_2 = Slider(3700, range=1..5000)
multiplication = Multiplication(A=number_slider, B=Slider(3, range=0..10))
rectangle = Rectangle(Plane=PlaneXY(0, 0, 0), XSize=number_slider_2, YSize=number_slider_2, Radius=0)  # -> Rectangle, Length
rectangle_2 = Rectangle(Plane=PlaneXY(0, 0, 0), XSize=Slider(1140, range=1..2000), YSize=Slider(4450, range=1..5000), Radius=0)  # -> Rectangle, Length
rectangle_3 = Rectangle(Plane=PlaneXY(0, 0, 0), XSize=number_slider, YSize=multiplication, Radius=0)  # -> Rectangle, Length
panel = Panel(rectangle.Rectangle)
panel_2 = Panel(rectangle.Length)
panel_3 = Panel(rectangle_2.Rectangle)
panel_4 = Panel(rectangle_2.Length)
panel_5 = Panel(rectangle_3.Rectangle)
panel_6 = Panel(rectangle_3.Length)
