# Grasshopper definition week2_3.gh (Grasshopper 1.0.8)
# plug-ins: Bifocals

curve = Curve(<curve referenced from the Rhino model>)
divide_curve = DivideCurve(Curve=curve, Count=Slider(9, range=1..20), Kinks=False)  # -> Points, Tangents, Parameters
panel = Panel(divide_curve.Points)
circle_cnr = CircleCNR(Center=divide_curve.Points, Normal=Vector(0, 0, 1), Radius=Slider(540, range=1..1000))
panel_2 = Panel(circle_cnr)
param_viewer = ParamViewer(panel_2)
