# Grasshopper definition week2_4.gh (Grasshopper 1.0.8)
# plug-ins: Bifocals

curve = Curve(<curve referenced from the Rhino model>)
divide_curve = DivideCurve(Curve=curve, Count=Slider(15, range=0..100), Kinks=False)  # -> Points, Tangents, Parameters
merge = Merge(Data1=Slider(50, range=0..100), Data2=Slider(2000, range=0..10000))
panel = Panel(divide_curve.Points)
point = Point(<point referenced from the Rhino model>)
bounds = Bounds(Numbers=merge)
distance = Distance(PointA=divide_curve.Points, PointB=point)
bounds_2 = Bounds(Numbers=distance)
remap_numbers = RemapNumbers(Value=distance, Source=bounds_2, Target=bounds)  # -> Mapped, Clipped
panel_2 = Panel(remap_numbers.Mapped)
circle_cnr = CircleCNR(Center=divide_curve.Points, Normal=Vector(0, 0, 1), Radius=remap_numbers.Mapped)
