# Grasshopper definition week2_5.gh (Grasshopper 1.0.8)

pi = Pi(Factor=Slider(2, range=0..10))
pi_2 = Pi(Factor=1)
construct_domain = ConstructDomain(DomainStart=Slider(0, range=0..100), DomainEnd=pi)
range = Range(Domain=construct_domain, Steps=Slider(200, range=0..1000))
list_item = ListItem(List=range, Index=Slider(198, range=0..199), Wrap=True)
expression = Expression(a=Slider(3, range=0..10), t=list_item, d=pi_2, Expression="sin(a*t+d)")
expression_2 = Expression(b=Slider(4, range=0..10), t=list_item, Expression="sin(b*t)")
construct_point = ConstructPoint(XCoordinate=expression, YCoordinate=expression_2, ZCoordinate=0)
panel = Panel(expression)
