# Grasshopper definition week2_basic.gh (Grasshopper 1.0.8)
# plug-ins: Bifocals

# ----
# Input
number_slider = Slider(748, range=0..10000)
curve = Curve(<curve referenced from the Rhino model>)

# ----
# Script
unit_z = UnitZ(Factor=number_slider)
move = Move(Geometry=curve, Motion=unit_z)  # -> Geometry, Transform

# ----
# Output
panel = Panel(move.Geometry)
panel_2 = Panel(move.Transform)
