# Grasshopper definition week2_intermediate.gh (Grasshopper 1.0.8)
# plug-ins: Bifocals

series = Series(Start=Slider(0, range=0..100), Step=Slider(1000, range=0..1000), Count=Slider(20, range=0..100))
panel = Panel(series)
cross_reference = CrossReference(ListA=series, ListB=series, CrossMode=1)  # -> ListA, ListB
point = Point(<point referenced from the Rhino model>)
unit_z = UnitZ(Factor=1)
construct_point = ConstructPoint(XCoordinate=cross_reference.ListA, YCoordinate=cross_reference.ListB, ZCoordinate=0)
panel_2 = Panel(cross_reference.ListA)
distance = Distance(PointA=construct_point, PointB=point)
param_viewer = ParamViewer(construct_point)
plane_normal = PlaneNormal(Origin=construct_point, ZAxis=unit_z)
panel_3 = Panel(cross_reference.ListB)
construct_domain = ConstructDomain(DomainStart=Slider(100, range=0..100), DomainEnd=Slider(3000, range=0..10000))
bounds = Bounds(Numbers=distance)
panel_4 = Panel(construct_point)
remap_numbers = RemapNumbers(Value=distance, Source=bounds, Target=construct_domain)  # -> Mapped, Clipped
polygon = Polygon(Plane=plane_normal, Radius=remap_numbers.Mapped, Segments=Slider(4, range=3..8), FilletRadius=0)  # -> Polygon, Length
panel_5 = Panel(polygon.Polygon)
