# Grasshopper definition week3_Attractor.gh (Grasshopper 1.0.8)
# plug-ins: Bifocals

# ----
# Step 1: Grid Points 만들기
number_slider = Slider(10, range=0..10)
series = Series(Start=Slider(0, range=0..100), Step=Slider(10, range=0..10), Count=number_slider)  # -> graft(Series)
series_2 = Series(Start=Slider(0, range=0..100), Step=Slider(10, range=0..10), Count=Slider(10, range=0..10))
param_viewer = ParamViewer(series)
param_viewer_2 = ParamViewer(series_2)
panel = Panel(series)
panel_2 = Panel(series_2)
construct_point = ConstructPoint(XCoordinate=graft(series_2), YCoordinate=series_2, ZCoordinate=0)

# ----
# Rectangular/Square 컴포넌트 사용
number_slider_2 = Slider(10, range=0..10)
rectangular = Rectangular(
    Plane=PlaneXY(0, 0, 0),
    SizeX=Slider(10, range=0..10),
    SizeY=Slider(10, range=0..10),
    ExtentX=number_slider_2,
    ExtentY=number_slider_2)  # -> Cells, simplify(Points)
param_viewer_3 = ParamViewer(rectangular.Points)
panel_3 = Panel(rectangular.Points)
point = Point(rectangular.Points)

construct_domain = ConstructDomain(DomainStart=Slider(0, range=0..100), DomainEnd=Slider(10, range=0..10))
random = Random(Range=construct_domain, Number=Slider(2, range=0..10), Seed=Slider(187906, range=0..1000000), Integers=True)
round = Round(Number=random)  # -> Nearest, Floor, Ceiling
panel_4 = Panel(round.Floor)
panel_5 = Panel(random)

list_item = ListItem(List=point, Index=Slider(3, range=0..10), Wrap=True)
param_viewer_4 = ParamViewer(list_item)
list_item_2 = ListItem(List=flatten(list_item), Index=Slider(5, range=0..10), Wrap=True)
param_viewer_5 = ParamViewer(list_item_2)

# ----
# Step 2: Attractor 정의
number_slider_3 = Slider(5, range=0..10)
list_item_3 = ListItem(List=simplify(construct_point), Index=Slider(3, range=0..10), Wrap=True)
param_viewer_6 = ParamViewer(list_item_3)
list_item_4 = ListItem(List=flatten(list_item_3), Index=number_slider_3, Wrap=True)
param_viewer_7 = ParamViewer(list_item_4)
panel_6 = Panel(list_item_4)
panel_7 = Panel(list_item_3)

line = Line(StartPoint=list_item_4, EndPoint=flatten(construct_point))
distance = Distance(PointA=list_item_4, PointB=flatten(construct_point))
bounds = Bounds(Numbers=distance)
construct_domain_2 = ConstructDomain(DomainStart=Slider(0, range=0..100), DomainEnd=Slider(10, range=0..10))
remap_numbers = RemapNumbers(Value=distance, Source=bounds, Target=construct_domain_2)  # -> Mapped, Clipped
circle_cnr = CircleCNR(Center=flatten(construct_point), Normal=Vector(0, 0, 1), Radius=remap_numbers.Mapped)
panel_8 = Panel(distance)
panel_9 = Panel(circle_cnr)
