# Grasshopper definition week3_계단.gh (Grasshopper 1.0.8)
# plug-ins: Bifocals

number_slider = Slider(300, range=0..1000)
multiplication = Multiplication(A=number_slider, B=Slider(20, range=0..100))
construct_point = ConstructPoint(XCoordinate=0, YCoordinate=0, ZCoordinate=0)
unit_x = UnitX(Factor=Slider(1000, range=0..1000))
unit_y = UnitY(Factor=1)
line_sdl = LineSDL(Start=construct_point, Direction=unit_y, Length=multiplication)
move = Move(Geometry=line_sdl, Motion=unit_x)  # -> Geometry, Transform
divide_length = DivideLength(Curve=move.Geometry, Length=number_slider)  # -> Points, Tangents, Parameters
divide_length_2 = DivideLength(Curve=line_sdl, Length=number_slider)  # -> Points, Tangents, Parameters
number_slider_2 = Slider(1, range=0..1)
number_slider_3 = Slider(150, range=0..1000)
line = Line(StartPoint=divide_length_2.Points, EndPoint=divide_length.Points)
point_list = PointList(Points=divide_length.Points, Size=Slider(300, range=0..10000))
boolean_toggle = BooleanToggle(False)
negative = Negative(Value=number_slider_2)
shift_list = ShiftList(List=line, Shift=negative, Wrap=boolean_toggle)  # -> simplify(graft(List))
shift_list_2 = ShiftList(List=line, Shift=number_slider_2, Wrap=boolean_toggle)  # -> simplify(graft(List))
panel = Panel(shift_list)
loft = Loft(
    Curves=[shift_list_2, shift_list],
    Options={Adjust=False, Closed=False, LoftEnds=0, LoftSimp=0, LoftType=0, Rebuild=10, Refit=0.01})  # -> flatten(Loft)
list_length = ListLength(List=loft)
series = Series(Start=number_slider_3, Step=number_slider_3, Count=list_length)
unit_z = UnitZ(Factor=series)
unit_z_2 = UnitZ(Factor=Slider(150, range=0..1000))
move_2 = Move(Geometry=loft, Motion=unit_z)  # -> Geometry, Transform
panel_2 = Panel(loft)
negative_2 = Negative(Value=unit_z_2)
extrude = Extrude(Base=move_2.Geometry, Direction=negative_2)
