# Grasshopper definition week3_원형램프.gh (Grasshopper 1.0.8)
# plug-ins: Bifocals

number_slider = Slider(16, range=0..100)
construct_point = ConstructPoint(XCoordinate=0, YCoordinate=0, ZCoordinate=0)
unit_x = UnitX(Factor=1)
point = Point(construct_point)
division = Division(A=Slider(6000, range=0..10000), B=number_slider)
unit_x_2 = UnitX(Factor=Slider(3800, range=0..10000))
line_sdl = LineSDL(Start=point, Direction=unit_x, Length=Slider(4100, range=0..10000))
series = Series(Start=0, Step=1, Count=number_slider)
series_2 = Series(Start=0, Step=division, Count=number_slider)
move = Move(Geometry=line_sdl, Motion=unit_x_2)  # -> Geometry, Transform
unit_z = UnitZ(Factor=series_2)
rotate = Rotate(Geometry=move.Geometry, Angle=series, Plane=point)  # -> Geometry, Transform
move_2 = Move(Geometry=rotate.Geometry, Motion=unit_z)  # -> Geometry, Transform
negative = Negative(Value=Slider(150, range=0..1000))
unit_z_2 = UnitZ(Factor=negative)
loft = Loft(Curves=move_2.Geometry, Options={Adjust=False, Closed=False, LoftEnds=0, LoftSimp=0, LoftType=0, Rebuild=10, Refit=0.01})
extrude = Extrude(Base=loft, Direction=unit_z_2)
