# Grasshopper definition week4_anemone_practice.gh (Grasshopper 1.0.8)
# plug-ins: Anemone, Bifocals

# ----
# Loop에 활용되는 데이터
number_slider = Slider(5, range=0..10)
series = Series(Start=0, Step=Slider(2, range=0..10), Count=number_slider)
panel = Panel(series)

# ----
# Loop 반복 횟수
number_slider_2 = Slider(10, range=0..10)

loop_start = LoopStart(Repeat=number_slider_2, Trigger=Button(), Data=series)  # -> port, Counter, Data

# ----
# Loop 내부에서 수행할 연산
number_slider_3 = Slider(2, range=0..10)
multiplication = Multiplication(A=loop_start.Data, B=number_slider_3)

loop_end = LoopEnd(port=loop_start.port, Exit=False, Data=multiplication, TimeOutVal=0, pausedState=False, state="Constant output")
panel_2 = Panel(loop_end)
