# Grasshopper definition week4_anemone_practice2.gh (Grasshopper 1.0.8)
# plug-ins: Anemone, Bifocals

geometry = Geometry(<curve referenced from the Rhino model>)
loop_start = LoopStart(Repeat=Slider(10, range=0..10), Trigger=Button(), Data=geometry)  # -> port, Counter, Data
geometry_2 = Geometry(loop_start.Data)

# ----
# Rotate and Scale
number_slider = Slider(20, range=0..100)
polygon_center = PolygonCenter(Polyline=geometry_2)  # -> CenterV, CenterE, CenterA
rotate = Rotate(Geometry=geometry_2, Angle=number_slider, Plane=polygon_center.CenterV)  # -> Geometry, Transform
scale = Scale(Geometry=rotate.Geometry, Center=polygon_center.CenterV, Factor=Slider(0.72, range=0..1))  # -> Geometry, Transform

geometry_3 = Geometry(scale.Geometry)
loop_end = LoopEnd(port=loop_start.port, Exit=False, Data=geometry_3, TimeOutVal=0, pausedState=False, state="Constant & Record")
