# Grasshopper definition week4_anemone_practice3.gh (Grasshopper 1.0.8)
# plug-ins: Anemone, Bifocals

line = Line(Line((16.42615156, -367.7358033, 0), (298.37186, 1011.420313, 0)))
loop_start = LoopStart(Repeat=Slider(10, range=0..10), Trigger=Button(), Data=line)  # -> port, Counter, Data
line_2 = Line(loop_start.Data)

# ----
# 두갈래로 나누기
end_points = EndPoints(Curve=line_2)  # -> Start, End
vector_2pt = Vector2Pt(PointA=end_points.Start, PointB=end_points.End, Unitize=False)  # -> Vector, Length
panel = Panel("""0.5
-0.5""")
move = Move(Geometry=line_2, Motion=vector_2pt.Vector)  # -> Geometry, Transform
scale = Scale(Geometry=move.Geometry, Center=end_points.End, Factor=Slider(0.7, range=0..1))  # -> Geometry, Transform
rotate = Rotate(Geometry=scale.Geometry, Angle=panel, Plane=end_points.End)  # -> Geometry, Transform

line_3 = Line(graft(rotate.Geometry))
loop_end = LoopEnd(port=loop_start.port, Exit=False, Data=line_3, TimeOutVal=0, pausedState=False, state="Constant & Record")
