# Grasshopper definition week4_python3_basic.gh (Grasshopper 1.0.8)
# plug-ins: Bifocals

python_3_script = Python3Script(n_floor=Slider(5, range=0..10), floor_height=Slider(4200, range=0..10000))  # -> out, a, pt, vec, line; inputs n_floor: Int32
# ---------- python_3_script: Python ----------
import Rhino.Geometry as rg

a = n_floor * floor_height
pt = rg.Point3d(0,0,0)
vec = rg.Vector3d(0,0,1)
line = rg.Line(pt, rg.Point3d(0,0,1000))
# ---------- end python_3_script ----------
panel = Panel(python_3_script.a)
panel_2 = Panel(python_3_script.pt)
panel_3 = Panel(python_3_script.vec)
panel_4 = Panel(python_3_script.line)
point = Point(python_3_script.pt)
vector = Vector(python_3_script.vec)
line = Line(python_3_script.line)
