# Grasshopper definition week4_python3_tower.gh (Grasshopper 1.0.8)
# plug-ins: Bifocals

total_height = Slider(50000, range=0..100000)
number_slider = Slider(8, range=2..50)
geometry = Geometry(<curve referenced from the Rhino model>)
pi = Pi(Factor=Slider(0.3, range=0..0.5))
subtraction = Subtraction(A=number_slider, B=Slider(1, range=0..1))

# ----
# 기본 매스 윤곽 만들기
division = Division(A=total_height, B=subtraction)
division_2 = Division(A=pi, B=subtraction)
series = Series(Start=0, Step=division, Count=number_slider)
unit_z = UnitZ(Factor=series)
series_2 = Series(Start=0, Step=division_2, Count=number_slider)
move = Move(Geometry=geometry, Motion=unit_z)  # -> Geometry, Transform
rotate = Rotate(Geometry=move.Geometry, Angle=series_2, Plane=PlaneXY(0, 0, 0))  # -> Geometry, Transform
panel = Panel(rotate.Geometry)

# ----
# Loft로 Brep 생성(Curve별)
python_3_script = Python3Script(curves=rotate.Geometry)  # -> out, surfaces; inputs curves: list of Curve
# ---------- python_3_script: Python ----------
import Rhino.Geometry as rg

surfaces = []
for i in range(len(curves)-1):
    loft = rg.Brep.CreateFromLoft([curves[i], curves[i+1]], rg.Point3d.Unset, rg.Point3d.Unset, rg.LoftType.Normal, False)
    surfaces.append(loft[0])
# ---------- end python_3_script ----------
panel_2 = Panel(python_3_script.surfaces)
list_item = ListItem(List=python_3_script.surfaces, Index=Slider(8, range=0..10), Wrap=True)

# ----
# Loft로 Brep 생성(한 번에)
loft = Loft(Curves=rotate.Geometry, Options={Adjust=False, Closed=False, LoftEnds=0, LoftSimp=0, LoftType=0, Rebuild=10, Refit=0.01})
panel_3 = Panel(loft)

# ----
# 3층 이상
number_slider_2 = Slider(4000, range=0..10000)

# ----
# 1~2층 층고
number_slider_3 = Slider(5000, range=0..10000)

# ----
# 슬라브 생성
number_slider_4 = Slider(300, range=0..1000)
xy_plane = XYPlane(Origin=Point(0, 0, 0))
negative = Negative(Value=number_slider_4)
unit_z_2 = UnitZ(Factor=negative)
python_3_script_2 = Python3Script(floor_height_1=number_slider_3, floor_height_2=number_slider_2)  # -> out, levels_z, floor_n; inputs floor_height_1: Int32, floor_height_2: Int32
# ---------- python_3_script_2: Python ----------
levels_z = []

temp_level = 0
floor_n = 1

while temp_level < 50000:
    if floor_n < 3:
        temp_level += floor_height_1
    else:
        temp_level += floor_height_2
    
    levels_z.append(temp_level)
    floor_n += 1
# ---------- end python_3_script_2 ----------
unit_z_3 = UnitZ(Factor=python_3_script_2.levels_z)
move_2 = Move(Geometry=xy_plane, Motion=unit_z_3)  # -> Geometry, Transform
move_3 = Move(Geometry=move_2.Geometry, Motion=unit_z_2)  # -> Geometry, Transform
panel_4 = Panel(python_3_script_2.levels_z)
panel_5 = Panel(python_3_script_2.floor_n)
brep_plane = BrepPlane(Brep=loft, Plane=move_3.Geometry)  # -> Curves, Points
brep_plane_2 = BrepPlane(Brep=loft, Plane=move_2.Geometry)  # -> Curves, Points
loft_2 = Loft(
    Curves=[brep_plane_2.Curves, brep_plane.Curves],
    Options={Adjust=False, Closed=False, LoftEnds=0, LoftSimp=0, LoftType=0, Rebuild=10, Refit=0.01})
cap_holes = CapHoles(Brep=loft_2)

# ----
# 3개층마다 발코니 돌출
number_slider_5 = Slider(1500, range=0..10000)
negative_2 = Negative(Value=number_slider_5)
python_3_script_3 = Python3Script(
    upper_base_plane=move_2.Geometry,
    upper_slab_curves=flatten(brep_plane_2.Curves),
    lower_base_plane=move_3.Geometry,
    lower_slab_curves=flatten(brep_plane.Curves),
    offset_length=negative_2)  # -> out, graft(offset_upper_slab_curves), graft(offset_lower_slab_curves); inputs upper_base_plane: list of Plane, upper_slab_curves: list of Curve, lower_base_plane: list of Plane, lower_slab_curves: list of Curve, offset_length: Int32
# ---------- python_3_script_3: Python ----------
import Rhino.Geometry as rg
import scriptcontext as sc

tol = sc.doc.ModelAbsoluteTolerance

offset_upper_slab_curves = []
offset_lower_slab_curves = []

for i in range(len(upper_slab_curves)):
    if i % 3 == 1:
        # Offset 결과 (Curve[])
        up_offset = upper_slab_curves[i].Offset(upper_base_plane[i], offset_length, tol, rg.CurveOffsetCornerStyle.Sharp)
        lo_offset = lower_slab_curves[i].Offset(lower_base_plane[i], offset_length, tol, rg.CurveOffsetCornerStyle.Sharp)

        # Join 후 첫 번째 커브만 추가
        up_joined = rg.Curve.JoinCurves(up_offset, tol)
        lo_joined = rg.Curve.JoinCurves(lo_offset, tol)

        offset_upper_slab_curves.append(up_joined[0] if up_joined else upper_slab_curves[i])
        offset_lower_slab_curves.append(lo_joined[0] if lo_joined else lower_slab_curves[i])
    else:
        offset_upper_slab_curves.append(upper_slab_curves[i])
        offset_lower_slab_curves.append(lower_slab_curves[i])
# ---------- end python_3_script_3 ----------
loft_3 = Loft(
    Curves=[python_3_script_3.offset_upper_slab_curves, python_3_script_3.offset_lower_slab_curves],
    Options={Adjust=False, Closed=False, LoftEnds=0, LoftSimp=0, LoftType=0, Rebuild=10, Refit=0.01})
cap_holes_2 = CapHoles(Brep=loft_3)
panel_6 = Panel(python_3_script_3.offset_upper_slab_curves)
