# Grasshopper definition week4_random_button.gh (Grasshopper 1.0.8)
# plug-ins: Bifocals

number_slider = Slider(10, range=0..10)
number_slider_2 = Slider(100, range=0..100)
number_slider_3 = Slider(0, range=0..100)
construct_domain = ConstructDomain(DomainStart=number_slider_3, DomainEnd=number_slider_2)
random = Random(Range=construct_domain, Number=number_slider, Seed=Button())
panel = Panel(random)

python_3_script = Python3Script(number=number_slider, min_value=number_slider_3, max_value=number_slider_2, btn=Button())  # -> out, seed, random_nums; inputs number: Int32, min_value: Double, max_value: Double, btn: Boolean
# ---------- python_3_script: Python ----------
import random
import scriptcontext as sc

# 상태 초기화
if "rand_seed" not in sc.sticky:
    sc.sticky["rand_seed"] = 1
if "btn_prev" not in sc.sticky:
    sc.sticky["btn_prev"] = False

# 버튼 '엣지' 감지 (False -> True 순간)
if btn and not sc.sticky["btn_prev"]:
    sc.sticky["rand_seed"] += 1

# 버튼 상태 기억
sc.sticky["btn_prev"] = btn

# 시드 고정 및 RNG 준비
seed = sc.sticky["rand_seed"]
rng = random.Random(seed)

# 안전한 범위 결정
a, b = (min_value, max_value) if min_value <= max_value else (max_value, min_value)
count = max(0, int(number))

# 난수 생성
random_nums = [rng.uniform(a, b) for _ in range(count)]
# ---------- end python_3_script ----------
panel_2 = Panel(python_3_script.seed)
panel_3 = Panel(python_3_script.random_nums)
panel_4 = Panel(python_3_script.out)
