# Grasshopper definition week5_brick_starter.gh (Grasshopper 1.0.8)
# plug-ins: PTComponentLibrary, Bifocals

# ----
# Wall Line
# X-values
# Y-values
# Z-values
number_slider = Slider(1000, range=0..1000)
number_slider_2 = Slider(3195, range=0..10000)
number_slider_3 = Slider(3000, range=0..10000)
number_slider_4 = Slider(5667, range=0..10000)
number_slider_5 = Slider(0, range=0..100)
unit_z = UnitZ(Factor=1)
construct_point = ConstructPoint(XCoordinate=number_slider, YCoordinate=number_slider_4, ZCoordinate=0)
construct_point_2 = ConstructPoint(XCoordinate=number_slider_2, YCoordinate=number_slider_4, ZCoordinate=0)
construct_point_3 = ConstructPoint(XCoordinate=number_slider_2, YCoordinate=number_slider_3, ZCoordinate=0)
construct_point_4 = ConstructPoint(XCoordinate=number_slider, YCoordinate=number_slider_3, ZCoordinate=0)
line_sdl = LineSDL(Start=construct_point_4, Direction=unit_z, Length=Slider(834, range=0..10000))
merge = Merge(Data1=construct_point_4, Data2=construct_point_3, Data3=construct_point_2, Data4=construct_point)
polyline = PolyLine(Vertices=merge, Closed=Toggle(True))

# ----
# 벽돌 치수
number_slider_6 = Slider(95, range=0..100)
number_slider_7 = Slider(45, range=0..100)
number_slider_8 = Slider(57, range=0..100)
negative = Negative(Value=number_slider_6)
negative_2 = Negative(Value=number_slider_7)
construct_domain = ConstructDomain(DomainStart=0, DomainEnd=number_slider_8)
construct_domain_2 = ConstructDomain(DomainStart=negative, DomainEnd=number_slider_6)
construct_domain_3 = ConstructDomain(DomainStart=negative_2, DomainEnd=number_slider_7)

# ----
# 줄눈 치수
number_slider_9 = Slider(2, range=0..10)
number_slider_10 = Slider(10, range=0..20)
multiplication = Multiplication(A=number_slider_9, B=number_slider_6)
addition = Addition(A=number_slider_10, B=multiplication)
addition_2 = Addition(A=number_slider_10, B=number_slider_8)

# ----
# 벽면 Curve 정렬
divide_distance = DivideDistance(Curve=line_sdl, Distance=addition_2, AddEnd=True)
vector_2pt = Vector2Pt(PointA=construct_point_4, PointB=divide_distance, Unitize=False)  # -> Vector, Length
move = Move(Geometry=polyline, Motion=vector_2pt.Vector)  # -> Geometry, Transform
explode = Explode(Curve=move.Geometry, Recursive=True)  # -> Segments, Vertices
list_item = ListItem(List=explode.Segments, Index=Slider(0, range=0..100), Wrap=True)
flip_curve = FlipCurve(Curve=explode.Segments, Guide=list_item)  # -> Curve, Flag
join_curves = JoinCurves(Curves=flip_curve.Curve, Preserve=False)

# ----
# 벽돌 라인 생성
divide_distance_2 = DivideDistance(Curve=join_curves, Distance=addition, AddEnd=True)
list_length = ListLength(List=divide_distance_2)
perp_frames = PerpFrames(Curve=join_curves, Count=list_length, Align=True)  # -> Frames, Parameters
domain_box = DomainBox(Base=perp_frames.Frames, X=construct_domain_2, Y=construct_domain_3, Z=construct_domain)
pi = Pi(Factor=Slider(1.5, range=0..10))
deconstruct_plane = DeconstructPlane(Plane=perp_frames.Frames)  # -> Origin, XAxis, YAxis, ZAxis
construct_plane = ConstructPlane(Origin=deconstruct_plane.Origin, XAxis=deconstruct_plane.XAxis, YAxis=deconstruct_plane.ZAxis)
rotate = Rotate(Geometry=domain_box, Angle=pi, Plane=construct_plane)  # -> Geometry, Transform
construct_plane_2 = ConstructPlane(Origin=deconstruct_plane.Origin, XAxis=deconstruct_plane.XAxis, YAxis=deconstruct_plane.YAxis)

move_2 = Move(Geometry=rotate.Geometry, Motion=Vector(0, 0, 10))  # -> simplify(Geometry), Transform
param_viewer = ParamViewer(move_2.Geometry)

# ----
# 벽돌 개수
list_length_2 = ListLength(List=flatten(move_2.Geometry))
panel = Panel(list_length_2)

# ----
# R 범위
# G 범위
# B 범위
number_slider_11 = Slider(50, range=0..100)
construct_domain_4 = ConstructDomain(DomainStart=Slider(160, range=0..1000), DomainEnd=Slider(255, range=0..1000))
construct_domain_5 = ConstructDomain(DomainStart=number_slider_11, DomainEnd=Slider(100, range=0..100))
construct_domain_6 = ConstructDomain(DomainStart=Slider(0, range=0..100), DomainEnd=Slider(50, range=0..100))
random = Random(Range=construct_domain_4, Number=list_length_2, Seed=2)
random_2 = Random(Range=construct_domain_5, Number=list_length_2, Seed=2)
random_3 = Random(Range=construct_domain_6, Number=list_length_2, Seed=2)
colour_picker = ColourPicker(PickedColour=RGB(187, 59, 0))
round = Round(Number=random)  # -> Nearest, Floor, Ceiling
round_2 = Round(Number=random_3)  # -> Nearest, Floor, Ceiling
round_3 = Round(Number=random_2)  # -> Nearest, Floor, Ceiling
panel_2 = Panel(colour_picker)
panel_3 = Panel(round.Nearest)
panel_4 = Panel(round_2.Nearest)
panel_5 = Panel(round_3.Nearest)
colour_rgb = ColourRGB(Alpha=255, Red=panel_3, Green=panel_5, Blue=panel_4)
custom_preview = CustomPreview(Geometry=flatten(move_2.Geometry), Material=colour_rgb)
list_length_3 = ListLength(List=colour_rgb)
panel_6 = Panel(list_length_3)
