# Grasshopper definition week5_loading_data_from_app.gh (Grasshopper 1.0.8)
# plug-ins: gHowl, Bifocals

udp_receiver = UDPReceiver(Port=Slider(5005, range=0..10000), Pattern=0)  # -> Info, Data
panel = Panel(udp_receiver.Data)

python_3_script = Python3Script(input_json=udp_receiver.Data, Scale=Slider(1, range=0..1), Reset=Toggle(False))  # -> out, P, H, V; inputs input_json: String, Scale: Double, Reset: Boolean
# ---------- python_3_script: Python ----------
# Grasshopper Python3 Script (실내용)
import json
import math
import Rhino.Geometry as rg

if 'state' not in globals():
    state = {
        'pt': rg.Point3d(0, 0, 0),
        'velocity': rg.Vector3d(0, 0, 0),  # 속도 벡터 추가
        'last_ts': None
    }

P = state['pt']
H = 0.0
V = 0.0
Dt = 0.0

try:
    data = json.loads(input_json)
    ts = data.get('ts')
    
    # 방향 정보
    derived = data.get('derived', {})
    headingRad = derived.get('headingRad', 0.0) or 0.0
    
    # 가속도 정보 (중력 제외된 값 사용)
    motion = data.get('motion', {})
    accel = motion.get('acceleration', {}) or {}
    ax = accel.get('x', 0.0) or 0.0
    ay = accel.get('y', 0.0) or 0.0
    az = accel.get('z', 0.0) or 0.0
    
    # 시간 차이 계산
    if isinstance(ts, (int, float)):
        if state['last_ts'] is None:
            Dt = 0.0
        else:
            Dt = max(0.0, (ts - state['last_ts']) / 1000.0)
        state['last_ts'] = ts
    
    if Dt > 0:
        # 가속도 → 속도 누적 (v = v0 + a*t)
        # 노이즈 제거: 작은 가속도는 무시
        threshold = 0.1  # m/s² (튜닝 필요)
        
        if abs(ax) > threshold or abs(ay) > threshold:
            state['velocity'].X += ax * Dt * Scale
            state['velocity'].Y += ay * Dt * Scale
            state['velocity'].Z += az * Dt * Scale
            
            # 마찰/감속 시뮬레이션 (속도 감쇠)
            damping = 0.95  # 0~1 (1에 가까울수록 감속 없음)
            state['velocity'] *= damping
        else:
            # 움직임이 없으면 속도를 빠르게 감속
            state['velocity'] *= 0.8
        
        # 속도 → 위치 업데이트 (p = p0 + v*t)
        if not Reset:
            moveVec = state['velocity'] * Dt
            state['pt'].Transform(rg.Transform.Translation(moveVec))
    
    if Reset:
        state['pt'] = rg.Point3d(0, 0, 0)
        state['velocity'] = rg.Vector3d(0, 0, 0)
    
    P = state['pt']
    H = math.degrees(headingRad)
    V = state['velocity'].Length  # 현재 속도 크기
    
except Exception as e:
    print(f"Error: {e}")
# ---------- end python_3_script ----------
point = Point(python_3_script.P)
panel_2 = Panel(python_3_script.P)
panel_3 = Panel(python_3_script.H)
panel_4 = Panel(python_3_script.V)
