# Grasshopper definition week6_ladybug_example.gh (Grasshopper 1.0.8)
# plug-ins: Bifocals

panel = Panel("https://climate.onebuilding.org/WMO_Region_2_Asia/KOR_South_Korea/SO_Seoul/KOR_SO_Seoul.WS.471080_TMYx.zip")
downloadepw = LBDownloadWeather(weather_URL=panel)  # -> epw_file, stat_file, ddy_file; plug-in component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
epwmap = LBEPWmap(epw_map=Toggle(False))  # -> Output; plug-in component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
importepw = LBImportEPW(epw_file=downloadepw.epw_file)  # -> location, dry_bulb_temperature, dew_point_temperature, relative_humidity, wind_speed, wind_direction, direct_normal_rad, diffuse_horizontal_rad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; plug-in component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
importstat = LBImportSTAT(stat_file=downloadepw.stat_file)  # -> location, ashrae_zone, koppen_zone, clear_dir_norm_rad, clear_diff_horiz_rad, ann_heat_dday_996, ann_heat_dday_990, ann_cool_dday_004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; plug-in component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
importddy = LBImportDDY(ddy_file=downloadepw.ddy_file)  # -> location, design_days; plug-in component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
panel_2 = Panel(importepw.location)

timeop = LBTimeIntervalOperation(data=importepw.dry_bulb_temperature)  # -> daily, monthly, mon_per_hr; plug-in component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
construct_point = ConstructPoint(XCoordinate=0, YCoordinate=Slider(220869, range=0..300000), ZCoordinate=0)
monthlychart = LBMonthlyChart(data=timeop.monthly, base_pt=construct_point)  # -> out, data_mesh, data_lines, col_lines, legend, borders, labels, y_title, title, vis_set; plug-in component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

# ----
# Monthly Chart 그리기
number_slider = Slider(151456, range=0..300000)
construct_point_2 = ConstructPoint(XCoordinate=0, YCoordinate=number_slider, ZCoordinate=0)
monthlychart_2 = LBMonthlyChart(data=importepw.dry_bulb_temperature, base_pt=construct_point_2)  # -> out, data_mesh, data_lines, col_lines, legend, borders, labels, y_title, title, vis_set; plug-in component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

# ----
# Hourly Chart 그리기
number_slider_2 = Slider(50, range=0..100)
hourlyplot = LBHourlyPlot(data=importepw.dry_bulb_temperature, z_dim=number_slider_2, reverse_y=Toggle(False))  # -> out, mesh, legend, borders, labels, title, vis_set; plug-in component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

# ----
# Wind Rose 그리기
number_slider_3 = Slider(0, range=0..23)
construct_point_3 = ConstructPoint(XCoordinate=Slider(280480, range=0..300000), YCoordinate=Slider(300000, range=0..300000), ZCoordinate=0)
analysisperiod = LBAnalysisPeriod(
    start_month=Slider(8, range=1..12),
    start_day=Slider(1, range=1..31),
    start_hour=number_slider_3,
    end_month=Slider(8, range=1..12),
    end_day=Slider(31, range=1..31),
    end_hour=Slider(23, range=0..23))  # -> period, hoys, dates; plug-in component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
windrose = LBWindRose(
    data=importepw.wind_speed,
    wind_direction=importepw.wind_direction,
    center_pt=construct_point_3,
    period=analysisperiod.period)  # -> out, mesh, compass, orient_line, freq_line, windrose_line, legend, title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; plug-in component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

sunpath = LBSunPath(location=importepw.location, scale=1)  # -> out, vectors, altitudes, azimuths, hoys, sun_pts, analemma, daily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; plug-in component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
