# Grasshopper definition week6_site_modeling.gh (Grasshopper 1.0.8)
# plug-ins: Heron, Bifocals

# ----
# 주변건물
# N1A_B0010000.shp
file_path = FilePath("C:\Users\no130\Downloads\(B010)수치지도_376081995_2024_00000487092068\N1A_B0010000.shp")
import_vector = ImportVector(FilePath=file_path, ClipIt=False, PointsOnly=False)  # -> DataExtents, Fields, Values, FeatureGeometry
panel = Panel(import_vector.Fields)
panel_2 = Panel(import_vector.Values)

# ----
# 도로
# N1A_A0010000.shp
file_path_2 = FilePath("C:\Users\no130\Downloads\(B010)수치지도_376081995_2024_00000487092068\N1A_A0010000.shp")
import_vector_2 = ImportVector(FilePath=file_path_2, ClipIt=False, PointsOnly=False)  # -> DataExtents, Fields, Values, FeatureGeometry
panel_3 = Panel(import_vector_2.Fields)
panel_4 = Panel(import_vector_2.Values)

# ----
# 대지
# N1L_F0010000.shp
file_path_3 = FilePath("C:\Users\no130\Downloads\(B010)수치지도_376081995_2024_00000487092068\N1L_F0010000.shp")
import_vector_3 = ImportVector(FilePath=file_path_3, ClipIt=False, PointsOnly=False)  # -> DataExtents, Fields, Values, FeatureGeometry
panel_5 = Panel(import_vector_3.Fields)
panel_6 = Panel(import_vector_3.Values)

# ----
# 대략적인 층고
number_slider = Slider(4, range=0..10)

geometry = Geometry(import_vector.FeatureGeometry)

# ----
# 도로 선따라 extrude
geometry_2 = Geometry(import_vector_2.FeatureGeometry)
mesh_join = MeshJoin(Meshes=geometry_2)
mesh_edges = MeshEdges(Mesh=mesh_join)  # -> NakedEdges, InteriorEdges, NonManifoldEdges
unit_z = UnitZ(Factor=Slider(100, range=0..100))
curve = Curve(mesh_edges.NakedEdges)
extrude = Extrude(Base=curve, Direction=unit_z)

# ----
# 등고수치 값만 가져오기
number_slider_2 = Slider(1, range=0..1)
list_item = ListItem(List=import_vector_3.Values, Index=number_slider_2, Wrap=True)
bounds = Bounds(Numbers=flatten(list_item))
panel_7 = Panel(bounds)

# ----
# 등고 geometry
geometry_3 = Geometry(import_vector_3.FeatureGeometry)
unit_z_2 = UnitZ(Factor=list_item)
move = Move(Geometry=geometry_3, Motion=unit_z_2)  # -> Geometry, Transform
divide_length = DivideLength(Curve=move.Geometry, Length=Slider(10, range=1..10))  # -> Points, Tangents, Parameters

# ----
# 경계선 curve
curve_2 = Curve(import_vector_3.DataExtents)

# ----
# 건물 윤곽선
mesh_edges_2 = MeshEdges(Mesh=geometry)  # -> NakedEdges, InteriorEdges, NonManifoldEdges
join_curves = JoinCurves(Curves=mesh_edges_2.NakedEdges, Preserve=False)  # -> simplify(Curves)

list_item_2 = ListItem(List=import_vector.Values, Index=Slider(5, range=0..10), Wrap=True)
panel_8 = Panel(list_item_2)
panel_9 = Panel(join_curves)

# ----
# 모퉁이 점
discontinuity = Discontinuity(Curve=curve_2, Level=1)  # -> Points, Parameters
closest_points = ClosestPoints(Point=discontinuity.Points, Cloud=flatten(divide_length.Points), Count=Slider(1, range=0..1))  # -> flatten(ClosestPoint), CPIndex, Distance
deconstruct = Deconstruct(Point=discontinuity.Points)  # -> XComponent, YComponent, ZComponent
deconstruct_2 = Deconstruct(Point=closest_points.ClosestPoint)  # -> XComponent, YComponent, ZComponent
construct_point = ConstructPoint(XCoordinate=deconstruct.XComponent, YCoordinate=deconstruct.YComponent, ZCoordinate=deconstruct_2.ZComponent)

multiplication = Multiplication(A=list_item_2, B=number_slider)
unit_z_3 = UnitZ(Factor=multiplication)
extrude_2 = Extrude(Base=join_curves, Direction=unit_z_3)
panel_10 = Panel(closest_points.ClosestPoint)
cap_holes = CapHoles(Brep=extrude_2)
merge = Merge(Data1=construct_point, Data2=divide_length.Points)  # -> flatten(Result)
panel_11 = Panel(merge)
delaunay_mesh = DelaunayMesh(Points=merge, Plane=PlaneXY(0, 0, 0))

# ----
# 주변건물을 Mesh 높이에 맞추기
discontinuity_2 = Discontinuity(Curve=join_curves, Level=1)  # -> simplify(Points), Parameters
panel_12 = Panel(discontinuity_2.Points)
unit_z_4 = UnitZ(Factor=1)
project_point = ProjectPoint(Point=discontinuity_2.Points, Direction=unit_z_4, Geometry=delaunay_mesh)  # -> Point, Index
panel_13 = Panel(project_point.Point)
deconstruct_3 = Deconstruct(Point=project_point.Point)  # -> XComponent, YComponent, ZComponent
panel_14 = Panel(deconstruct_3.ZComponent)
sort_list = SortList(Keys=deconstruct_3.ZComponent)  # -> Keys, ValuesA
panel_15 = Panel(sort_list.Keys)
list_item_3 = ListItem(List=sort_list.Keys, Index=Slider(0, range=0..100), Wrap=True)
panel_16 = Panel(list_item_3)
unit_z_5 = UnitZ(Factor=list_item_3)

# ----
# 윗판
mesh = Mesh(delaunay_mesh)

mesh_curve = MeshCurve(Mesh=mesh, Curve=extrude)  # -> simplify(Points), Faces
list_item_4 = ListItem(List=mesh_curve.Points, Index=Slider(0, range=0..100), Wrap=True)  # -> Item, Item1
line = Line(StartPoint=list_item_4.Item, EndPoint=list_item_4.Item1)
curve_3 = Curve(curve_2)

# ----
# 아래로 Extrude
mesh_edges_3 = MeshEdges(Mesh=mesh)  # -> NakedEdges, InteriorEdges, NonManifoldEdges
negative = Negative(Value=Slider(30, range=0..100))
join_curves_2 = JoinCurves(Curves=mesh_edges_3.NakedEdges, Preserve=False)
unit_z_6 = UnitZ(Factor=negative)
extrude_3 = Extrude(Base=join_curves_2, Direction=unit_z_6)

# ----
# 원하는 모양만 남기기
number_slider_3 = Slider(0, range=0..1)
split_brep = SplitBrep(Brep=extrude_3, Cutter=curve_3)
list_item_5 = ListItem(List=split_brep, Index=number_slider_3, Wrap=True)
cap_holes_2 = CapHoles(Brep=list_item_5)
merge_2 = Merge(Data1=cap_holes_2, Data2=mesh)

move_2 = Move(Geometry=cap_holes, Motion=unit_z_5)  # -> Geometry, Transform
merge_3 = Merge(Data1=merge_2, Data2=move_2.Geometry, Data3=line)
