# Grasshopper definition ladybug_radiation.gh (Grasshopper 1.0.8)
# plug-ins: Bifocals

number_slider = Slider(0.01, range=0..0.01)

# ----
# face4
geometry = Geometry(<surface referenced from the Rhino model>)
window = Geometry([<surface referenced from the Rhino model> x36])
list_item = ListItem(List=window, Index=0, Wrap=True)
flip = Flip(Surface=flatten(window), Guide=list_item)  # -> Surface, Result
aperture = HBAperture(geo=flip.Surface)  # -> out, apertures; plug-in component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
face = HBFace(geo=geometry)  # -> out, faces; plug-in component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
addsubface = HBAddSubface(hb_obj=flatten(face.faces), sub_faces=flatten(aperture.apertures), project_dist=number_slider)  # -> out, hb_obj, unmatched; plug-in component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

# ----
# slab
geometry_2 = Geometry(<surface referenced from the Rhino model>)
face_2 = HBFace(geo=geometry_2)  # -> out, faces; plug-in component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

# ----
# ceiling
geometry_3 = Geometry(<surface referenced from the Rhino model>)
face_3 = HBFace(geo=geometry_3)  # -> out, faces; plug-in component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

# ----
# face3
geometry_4 = Geometry(<surface referenced from the Rhino model>)
geometry_5 = Geometry([<surface referenced from the Rhino model> x66])
list_item_2 = ListItem(List=geometry_5, Index=0, Wrap=True)
flip_2 = Flip(Surface=flatten(geometry_5), Guide=list_item_2)  # -> Surface, Result
aperture_2 = HBAperture(geo=flip_2.Surface)  # -> out, apertures; plug-in component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
face_4 = HBFace(geo=geometry_4)  # -> out, faces; plug-in component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
addsubface_2 = HBAddSubface(hb_obj=flatten(face_4.faces), sub_faces=flatten(aperture_2.apertures), project_dist=number_slider)  # -> out, hb_obj, unmatched; plug-in component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

# ----
# face1
geometry_6 = Geometry(<surface referenced from the Rhino model>)
geometry_7 = Geometry([<surface referenced from the Rhino model> x66])
list_item_3 = ListItem(List=geometry_7, Index=0, Wrap=True)
flip_3 = Flip(Surface=flatten(geometry_7), Guide=list_item_3)  # -> Surface, Result
aperture_3 = HBAperture(geo=flip_3.Surface)  # -> out, apertures; plug-in component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
face_5 = HBFace(geo=geometry_6)  # -> out, faces; plug-in component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
addsubface_3 = HBAddSubface(hb_obj=flatten(face_5.faces), sub_faces=flatten(aperture_3.apertures), project_dist=number_slider)  # -> out, hb_obj, unmatched; plug-in component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

# ----
# face2
geometry_8 = Geometry(<surface referenced from the Rhino model>)
window_2 = Geometry([<surface referenced from the Rhino model> x36])
list_item_4 = ListItem(List=window_2, Index=0, Wrap=True)
flip_4 = Flip(Surface=flatten(window_2), Guide=list_item_4)  # -> Surface, Result
aperture_4 = HBAperture(geo=flip_4.Surface)  # -> out, apertures; plug-in component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
face_6 = HBFace(geo=geometry_8)  # -> out, faces; plug-in component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
addsubface_4 = HBAddSubface(hb_obj=flatten(face_6.faces), sub_faces=flatten(aperture_4.apertures), project_dist=number_slider)  # -> out, hb_obj, unmatched; plug-in component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

number_slider_2 = Slider(12, range=1..12)
number_slider_3 = Slider(21, range=1..31)
number_slider_4 = Slider(12, range=0..23)
hoy = LBCalculateHOY(month=number_slider_2, day=number_slider_3, hour=number_slider_4, minute=Slider(0, range=0..59))  # -> flatten(hoy), flatten(doy), flatten(date); plug-in component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

panel = Panel("https://climate.onebuilding.org/WMO_Region_4_North_and_Central_America/USA_United_States_of_America/IL_Illinois/USA_IL_Chicago.OHare.Intl.AP.725300_TMYx.2004-2018.zip")
downloadepw = LBDownloadWeather(weather_URL=panel)  # -> epw_file, stat_file, ddy_file; plug-in component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
epwmap = LBEPWmap(epw_map=Toggle(False))  # -> Output; plug-in component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
wea = HBWeaFromEPW(epw_file=downloadepw.epw_file)  # -> wea; plug-in component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

importloc = LBImportLocation(epw_file=downloadepw.epw_file)  # -> location; plug-in component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

room = HBRoom(
    faces=flatten([addsubface_3.hb_obj, addsubface_4.hb_obj, addsubface_2.hb_obj, addsubface.hb_obj, face_2.faces, face_3.faces]),
    conditioned=True)  # -> out, room; plug-in component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
model = HBModel(rooms=flatten(room.room))  # -> out, model; plug-in component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
vizbytype = HBVisualizeByType(hb_objs=model.model)  # -> walls, interior_walls, roofs, ceilings, exterior_floors, interior_floors, air_walls, apertures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; plug-in component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

# ----
# Floor Grid Setting
number_slider_5 = Slider(10, range=0..10)
gridrooms = HBSensorGridFromRooms(rooms=model.model, grid_size=number_slider_5, dist_floor=Slider(0.2, range=0..1))  # -> grid, points, mesh; plug-in component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
assigngridsviews = HBAssignGridsAndViews(model=model.model, grids=flatten(gridrooms.grid))  # -> model; plug-in component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

ciesky = HBCIEStandardSky(location=importloc, month=number_slider_2, day=number_slider_3, hour=number_slider_4, type=0)  # -> sky; plug-in component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
vizwiref = HBVisualizeWireframe(hb_objs=flatten(model.model))  # -> geo; plug-in component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

legendpar = LBLegendParameters(max=Slider(2241, range=0..10000), seg_count=Slider(20, range=0..100))  # -> leg_par; plug-in component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
pitgrid = HBPointInTimeGridBased(model=assigngridsviews, sky=ciesky, run=Toggle(False))  # -> out, results; plug-in component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
heatmap = LBSpatialHeatmap(values=pitgrid.results, mesh=gridrooms.mesh, legend_par=legendpar)  # -> mesh, legend, title, colors, legend_par, vis_set; plug-in component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
